# Grasshopper definition 010 villa-savoye-pilotis-grid.gh (Grasshopper 1.0.8)

crv = Curve(<curve referenced from the Rhino model>)
drec = DeconstructRectangle(Rectangle=crv)  # -> BasePlane, XInterval, YInterval
bay_spacing_y_cm = Slider(300, range=50..800)
dedomain = DeconstructDomain(Domain=drec.XInterval)  # -> Start, End
dedomain_2 = DeconstructDomain(Domain=drec.YInterval)  # -> Start, End
bay_spacing_x_cm = Slider(300, range=50..800)
subtraction = Subtraction(A=dedomain_2.End, B=dedomain_2.Start)
subtraction_2 = Subtraction(A=dedomain.End, B=dedomain.Start)
integer_division = IntegerDivision(A=subtraction, B=bay_spacing_y_cm)
integer_division_2 = IntegerDivision(A=subtraction_2, B=bay_spacing_x_cm)
deplane = DeconstructPlane(Plane=drec.BasePlane)  # -> Origin, XAxis, YAxis, ZAxis
addition = Addition(A=integer_division_2, B=Slider(2, range=0..2))
addition_2 = Addition(A=integer_division, B=Slider(2, range=0..2))
series = Series(Start=dedomain_2.Start, Step=bay_spacing_y_cm, Count=addition_2)
series_2 = Series(Start=dedomain.Start, Step=bay_spacing_x_cm, Count=addition)
crossref = CrossReference(ListA=series_2, ListB=series, CrossMode=1)  # -> ListA, ListB
pt = ConstructPoint(XCoordinate=crossref.ListA, YCoordinate=crossref.ListB, ZCoordinate=0)
panel = Panel(crossref.ListB)
panel_2 = Panel(crossref.ListA)
move = Move(Geometry=pt, Motion=deplane.Origin)  # -> Geometry, Transform
incurve = PointInCurve(Point=move.Geometry, Curve=crv)  # -> Relationship, Point
cull = CullPattern(List=move.Geometry, CullPattern=incurve.Relationship)
panel_3 = Panel(cull)
